# Grasshopper definition GerillaTowerDemo_modified.gh (Grasshopper 0.9.14)
# plug-ins: gerilla

# ----
# Project Info
panel = Panel("C:\Users\Public\Documents\PAE\PAE 810\geRILLA\GerillaProjects")
project_information = GerillaProjectInformation(ProjectName="GerillaTowerDemo", ProjectFilePath=panel, CreateANewGerillaProject=Toggle(True))

# ----
# Assemblies
slider = Slider(4, range=0..10)
gerilla_assembly = GerillaAssemblyLibrary(SelectGerillaAssembly=[Slider(0, range=0..10), Slider(1, range=0..10), slider, Slider(6, range=0..10)])  # -> GerillaAssemblyIDF, GerillaAssemblyName

# ----
# Zone Geometry
slider_2 = Slider(7, range=0..100)
slider_3 = Slider(12, range=0..20)
series = Series(Start=slider_3, Step=slider_3, Count=slider_2)
Z = UnitZ(Factor=series)
dom = Domain(DomainStart=0, DomainEnd=Slider(30, range=0..100))
dom_2 = Domain(DomainStart=0, DomainEnd=Slider(50, range=0..100))
dom_3 = Domain(DomainStart=0, DomainEnd=slider_3)
box = DomainBox(Base=PlaneXY(0, 0, 0), X=dom, Y=dom_2, Z=dom_3)
move = Move(Geometry=box, Translation=Z)  # -> Geometry, Transform

panel_2 = Panel(gerilla_assembly.GerillaAssemblyName)

# ----
# Gerilla Zone
zone = GerillaZone(GerillaZones=[box, move.Geometry], NorthVector=Vector(0, 1, 0))  # -> GerillaZoneIDF, ZoneSurfaces

item = ListItem(List=gerilla_assembly.GerillaAssemblyName, Index=0, Wrap=False)
item_2 = ListItem(List=gerilla_assembly.GerillaAssemblyName, Index=1, Wrap=False)
item_3 = ListItem(List=gerilla_assembly.GerillaAssemblyName, Index=2, Wrap=False)
item_4 = ListItem(List=gerilla_assembly.GerillaAssemblyName, Index=3, Wrap=False)
viewer = ParamViewer(zone.GerillaZoneIDF)
material_maker = GerillaMaterialMaker(
    Name="MikesMaterial",
    Roughness=0,
    ThicknessM="0",
    ConductivityWMK="0",
    DensityKgM3="0",
    SpecificHeatJKgK="0",
    ThermalAbsorptance0To099="0",
    SolarAbsorptance0To099="0",
    VisibleAbsorptance0To099="0",
    SaveToProjectLibrary=Toggle(False),
    SaveToGerillaLibrary=Toggle(False))  # -> MaterialName, MaterialIDF
lng = ListLength(List=viewer)
series_2 = Series(Start=1, Step=1, Count=lng)
panel_3 = Panel(item)
panel_4 = Panel(item_4)
panel_5 = Panel(item_3)
panel_6 = Panel(item_4)
gerilla_materials = GerillaMaterialLibrary(SelectGerillaMaterial=Slider(7, range=0..10))
shift = ShiftList(List=series_2, Shift=1, Wrap=False)
shift_2 = ShiftList(List=series_2, Shift=-1, Wrap=False)
panel_7 = Panel("""1
2
3
4""")
panel_8 = Panel(gerilla_materials)

# ----
# Gerilla Surfaces
surface = GerillaSurface(GerillaSurfaces=zone.ZoneSurfaces, AssemblyName=panel_3, ZoneIndex=shift, FloorIndex="1", WallIndex=0, RoofIndex=0)  # -> GerillaSurfaceIDF, FloorSurfaces, WallSurfaces, RoofSurfaces
surface_2 = GerillaSurface(GerillaSurfaces=zone.ZoneSurfaces, AssemblyName=panel_3, ZoneIndex=shift_2, FloorIndex=0, WallIndex=0, RoofIndex="1")  # -> GerillaSurfaceIDF, FloorSurfaces, WallSurfaces, RoofSurfaces
surface_3 = GerillaSurface(GerillaSurfaces=zone.ZoneSurfaces, AssemblyName=panel_4, ZoneIndex=1, FloorIndex="1", WallIndex=0, RoofIndex=0)  # -> GerillaSurfaceIDF, FloorSurfaces, WallSurfaces, RoofSurfaces
surface_4 = GerillaSurface(GerillaSurfaces=zone.ZoneSurfaces, AssemblyName=panel_5, ZoneIndex=lng, FloorIndex=0, WallIndex=0, RoofIndex="1")  # -> GerillaSurfaceIDF, FloorSurfaces, WallSurfaces, RoofSurfaces
surface_5 = GerillaSurface(
    GerillaSurfaces=zone.ZoneSurfaces,
    AssemblyName=panel_6,
    ZoneIndex=series_2,
    FloorIndex=0,
    WallIndex=panel_7,
    RoofIndex=0)  # -> GerillaSurfaceIDF, FloorSurfaces, WallSurfaces, RoofSurfaces

panel_9 = Panel(surface.GerillaSurfaceIDF)

# ----
# EnergyPlus Results
results = EnergyPlusResults()  # -> ZoneHeatingMonthlyJMonth, ZoneCoolingMonthlyJMonth
panel_10 = Panel(results.ZoneCoolingMonthlyJMonth)
panel_11 = Panel(results.ZoneHeatingMonthlyJMonth)
sub_list = SubList(List=panel_10, Domain="1,12", Cycle=False)  # -> List, Index
panel_12 = Panel(sub_list.List)
string_split = StringSplit(String=panel_12, Separators=",")
list_item = ListItem(List=string_split, Index=0, Wrap=False)  # -> simplify(Element)
panel_13 = Panel(list_item)
shift_paths = ShiftPaths(Data=panel_13, Offset=-1)
panel_14 = Panel(shift_paths)

# ----
# EnergyPlus Simulation
toggle = BooleanToggle(False)
idf_compiler = GerillaIDFCompiler(
    WriteIDF=toggle,
    ZoneIDF=zone.GerillaZoneIDF,
    SurfaceIDF=[surface.GerillaSurfaceIDF, surface_2.GerillaSurfaceIDF, surface_3.GerillaSurfaceIDF, surface_4.GerillaSurfaceIDF, surface_5.GerillaSurfaceIDF],
    AssemblyIDF=gerilla_assembly.GerillaAssemblyIDF,
    RunPeriodIDF="default: full year simulation")  # -> EnergyPlusSimulationTrigger, IDFFile
path = FilePath("C:\EnergyPlusV8-0-0\WeatherData\USA_IL_Chicago-OHare.Intl.AP.725300_TMY3.epw")
simulate = EnergyPlusSimulation(RunEnergyPlusSimulation=idf_compiler.EnergyPlusSimulationTrigger, WeatherFilePath=path)

# ----
# Visualize results
month = Slider(6, range=0..11)
flatten_tree = FlattenTree(Data=panel_14, Path="{0}")
item_5 = ListItem(List=panel_14, Index=month, Wrap=False)  # -> flatten(Element)
bnd = Bounds(Numbers=flatten_tree)
domcomp = DomainComponents(Domain=bnd)  # -> Start, End
merge = Merge(Data1=box, Data2=move.Geometry)
gradient = Gradient(
    LowerLimit=domcomp.Start,
    UpperLimit=domcomp.End,
    Parameter=item_5,
    stops=[0: RGB(0, 128, 0), 0.5: RGB(255, 255, 0), 1: RGB(255, 0, 0)])
preview = CustomPreview(Geometry=flatten(merge), Shader=flatten(gradient))
